# Grasshopper definition configurator.gh (Grasshopper 1.0.8)
# plug-ins: treesloth01

height = GetNumber(
    Slider(317, range=100..1000),
    AtLeast=1,
    AtMost=2147483647,
    Maximum=1.797693135e+308,
    Minimum=-1.797693135e+308,
    TreeAccess=False)
depth = GetNumber(
    Slider(616, range=200..700),
    AtLeast=1,
    AtMost=2147483647,
    Maximum=1.797693135e+308,
    Minimum=-1.797693135e+308,
    TreeAccess=False)
width = GetNumber(
    Slider(1399, range=800..2000),
    AtLeast=1,
    AtMost=2147483647,
    Maximum=1.797693135e+308,
    Minimum=-1.797693135e+308,
    TreeAccess=False)

# ---- group: RH_IN: pause compute
bool = Boolean(invert(False))

# ----
num = GetNumber(
    Slider(4, range=1..5),
    AtLeast=1,
    AtMost=2147483647,
    Maximum=1.797693135e+308,
    Minimum=-1.797693135e+308,
    TreeAccess=False)
num_2 = Number(height)
num_3 = Number(width)
num_4 = Number(depth)
int = Integer(num)

# ----
# Structure
panel = Panel("storage unit")
panel_2 = Panel("{0}")
panel_3 = Panel("""{0} - straight
{1} - L 
{2} - U""")
panel_4 = Panel("column / outer carcass")
# {x,0} - outer carcass
#  [0] - top
#  [1] - bottom
#  [2] - front
#  [3] - back
#  [4] - left
#  [5] - right
# 
# 
# 
# {x,1} - column
#  [0] - left most
#  [1] - beside that
#  [2] -
panel_5 = Panel("{x,0}")
panel_6 = Panel("""shelf/shelf size
shutter/hardware""")
panel_7 = Panel("{x,x,0}")
panel_8 = Panel("""0 - bottom most
1 - above that
2 - above""")
panel_9 = Panel("surface")
panel_10 = Panel("{0,0,0,0}")
panel_11 = Panel("""0 - top
1 - bottom
2 - front
3 - back
4 - left
5 - right""")
panel_12 = Panel("placement point")
panel_13 = Panel("{0,0,0,0,0}")
panel_14 = Panel("""F -> B
L -> R
B -> T

0 - LBF
1 - """)
panel_15 = Panel("x/ y/ z")
panel_16 = Panel("{0,0,0,0,0,0}")
panel_17 = Panel("""0 - X
1 - Y
2 - Z""")

fascia = ShutterTypes({"Flushed": 0, "Flutted": 1, "Glass": 2, "Panelled": 3}, selected="Panelled")
shutter_type = Data(fascia)

leg = ValueList({"Skirting": 0, "Leg": 1, "Leg + Skiting": 2}, selected="Leg")
leg_type = Data(leg)

leg_height = ValueList({"100", "150", "200"}, selected="100")
leg_height_2 = Data(leg_height)

# ---- group: Backend Parameter
# Preset Design settings
panel_18 = Panel(leg_height_2)
channel_clearance = Data("12")
bottom_clearance = Data("12")
skirting_height = Data(panel_18)

# ----
carcass_length = Data(num_3)
carcass_depth = Data(num_4)
carcass_height = Data(num_2)
number_of_col = Data(int)
duplicate_data = DuplicateData(Data="2", Number=number_of_col, Order=True)

# ----
# starting from left
board1_thickness = Slider(18, range=0..30)
placement = ValueList({"middle": 0, "side": 1}, selected="side")
list_of_row_num = Data(duplicate_data)

mid_side = Data(placement)
board_thickness = Data(board1_thickness)
panel_19 = Panel("""This compnent calculates the shelving positions and sizes. Outputs the 
- positions as datatree of Point3d 
- sizes as datatree of Vector3d, where the x,y,z are essesntially the L,W,H """)
bool_2 = Boolean(bool)

carcass_length_2 = Data(carcass_length)
carcass_depth_2 = Data(carcass_depth)
carcass_height_2 = Data(carcass_height)
number_of_col_2 = Data(number_of_col)
board_thickness_2 = Data(board_thickness)
skirting_height_2 = Data(skirting_height)
list_of_row_num_2 = Data(flatten(list_of_row_num))
unit_placement = CSharpScript(
    description=panel_19,
    reset=bool_2,
    L=carcass_length_2,
    D=carcass_depth_2,
    H=carcass_height_2,
    num_col=number_of_col_2,
    board_thickness=board_thickness_2,
    skirting_height=skirting_height_2,
    list_of_row_num=list_of_row_num_2)  # -> out, placement, sizing; inputs reset: Boolean, L: Double, D: Double, H: Double, num_col: Int32, board_thickness: Double, skirting_height: Double, list_of_row_num: list of Int32
# ---------- unit_placement: C# ----------
    // Component written by Pallavi Ray
    // POST 105
    // August, 2023
    // V0.1
    Component.NickName = "unit_placement";
    Component.Description = "Calculates the placement of the unit bases for straight unit";


    if(init)
    {
      init = false;
      update(L, D, H, board_thickness, num_col, skirting_height,list_of_row_num);
    }

    if(reset)
    {
       _sizing.Clear();
       _placement.Clear();
      update(L, D, H, board_thickness, num_col, skirting_height,list_of_row_num);
    }

    placement = _placement;
    sizing = _sizing;
# ---------- unit_placement: C# additional code ----------
    bool init=true;
    //Set up dataTree Sizing
    public DataTree<Vector3d> _sizing = new DataTree<Vector3d>();
    //Set up dataTree Placement
    public DataTree < Point3d > _placement = new DataTree<Point3d>();

public void update(double L, double D, double H, double board_thickness, int num_col, double skirting_height, List <int> list_of_row_num )

{
    //Setup shelve details
    double shelve_length = (L - (2 * num_col * board_thickness)) / num_col;
    double shelve_depth = D - board_thickness;


    for(int i = 0; i < num_col;i++)
    {
      double num_row = list_of_row_num[i];
      double shelve_height = (H - ((num_row) *board_thickness) - skirting_height ) / num_row;

      for (int j = 0; j < list_of_row_num[i];j++)
      {

        GH_Path pth_0 = new GH_Path(0, i, j);
        _placement.Add(new Point3d(( (shelve_length * i) + ( ((i * 2) + 1) * board_thickness ) ),
          0.0,
          ((shelve_height * j) + skirting_height + (j * board_thickness))),
          pth_0);
      }
    }


    // double shelve_length = (L - ((num_col + 1) * board_thickness) ) / num_col;

    for(int i = 0; i < num_col;i++)
    {
      double num_row = list_of_row_num[i];
      double shelve_height = (H - ((num_row) *board_thickness) - skirting_height ) / num_row;

      for (int j = 0; j < list_of_row_num[i];j++)
      {

        GH_Path pth_0 = new GH_Path(0, i, j);

        //var shelve_height =
        Vector3d val = new Vector3d(shelve_length, shelve_depth, shelve_height);
        _sizing.Add(val, pth_0);
      }
    }
    return;
}
# ---------- end unit_placement ----------
shelves_placement_point3d = Data(unit_placement.placement)
shelves_sizing_vector3d = Data(unit_placement.sizing)

# ----
# Storage Unit : Column : Row
panel_20 = Panel("""Open
Drawer
Shutter""")
list_length = ListLength(List=panel_20)
shelves_placement = Data(shelves_placement_point3d)
tree_statistics = TreeStatistics(Tree=shelves_placement)  # -> Paths, Length, Count
random = Random(Range=list_length, Number=tree_statistics.Count, Seed=2, Integers=True)
copylisttotree = CSharpScript(to_match=shelves_placement, list=panel_20)  # -> out, A; inputs to_match: tree, list: list
# ---------- copylisttotree: C# ----------
    ///////////////////////////////DataTree///////////////////////////////
    //Set up tree
    DataTree<object> new_dt = new DataTree<object>();
    var p = to_match.Paths;

    for(int i = 0; i < p.Count;i++)
    {
     // GH_Path path = to_match. ;


      new_dt.AddRange(list, p[i]);


    }

    A = new_dt;
# ---------- end copylisttotree ----------
list_item = ListItem(List=panel_20, Index=random, Wrap=True)
tree_statistics_2 = TreeStatistics(Tree=graft(list_item))  # -> Paths, Length, Count
replace_paths = ReplacePaths(Data=graft(list_item), Search=tree_statistics_2.Paths, Replace=tree_statistics.Paths)

panel_21 = Panel(replace_paths)

# ---- group: Carcass base left corner
vec = VectorXYZ(XComponent="0", YComponent="0", ZComponent="0")  # -> Vector, Length
xy = XYPlane(Origin=vec.Vector)

# ----
shift_paths = ShiftPaths(Data=shelves_placement_point3d, Offset=-1)
bool_3 = Boolean(bool)
bool_4 = Boolean(bool)
bool_5 = Boolean(bool)
leg_type_2 = Data(leg_type)
leg_type_3 = Data(leg_type)
leg_type_4 = Data(leg_type)
num_5 = Number(leg_type_3)
num_6 = Number(leg_type_4)
num_7 = Number(leg_type_2)

# ----
# CARCASS
# This compnent generates the elements of the outer carcass as a data tree with path {0,0}[correspondind side numbmer].
# Depending on the leg type the geometry is decided
carcass_length_3 = Data(carcass_length)
carcass_height_3 = Data(carcass_height)
board_thickness_3 = Data(board_thickness)
pln = Plane(vec.Vector)
carcass_depth_3 = Data(carcass_depth)
skirting_height_3 = Data(skirting_height)
# This compnent generates the verticle columns as a data tree with path {0,1}[column number].
carcass_length_4 = Data(carcass_length)
carcass_depth_4 = Data(carcass_depth)
carcass_height_4 = Data(carcass_height)
board_thickness_4 = Data(board_thickness)
skirting_height_4 = Data(skirting_height)
shelves_placement_2 = Data(shift_paths)
# This compnent generates the SHELVES BASES as a data tree with path {x,x,column}[row].
carcass_length_5 = Data(carcass_length)
carcass_depth_5 = Data(carcass_depth)
carcass_height_5 = Data(carcass_height)
board_thickness_5 = Data(board_thickness)
skirting_height_5 = Data(skirting_height)
shelves_placement_3 = Data(shift_paths)
carcass_outer = CSharpScript(
    reset=bool_3,
    base=pln,
    L=carcass_length_3,
    D=carcass_depth_3,
    H=carcass_height_3,
    board_thickness=board_thickness_3,
    skirting_height=skirting_height_3,
    leg_type=num_5)  # -> out, outerCarcass; inputs reset: Boolean, base: Plane, L: Double, D: Double, H: Double, board_thickness: Double, skirting_height: Double, leg_type: Int32
# ---------- carcass_outer: C# ----------
    // Component written by Pallavi Ray
    // POST 105
    // August, 2023
    // V0.1
    Component.NickName = "Carcass_Outer";
    Component.Description = "Creates an outer carcass for straight unit";



    if(init)
    {
      init = false;
      bb.AddRange(update(L, D, H, board_thickness, skirting_height, leg_type), path);
    }

    if(reset)
    {
      bb.Clear();
      bb.AddRange(update(L, D, H, board_thickness, skirting_height, leg_type), path);
    }

    outerCarcass = bb;
# ---------- carcass_outer: C# additional code ----------
  public bool init = true;
  public DataTree<BoundingBox> bb = new DataTree<BoundingBox>();
  public GH_Path path = new GH_Path(0, 0);


  public List<BoundingBox>  update (double L, double D, double H, double board_thickness, double skirting_height, int leg_type)
  {

    List<BoundingBox> b = new List<BoundingBox > ();

    BoundingBox base_box = new BoundingBox(new Point3d(0, 0, 0), new Point3d(1, 1, 1));
    //Box base_box = new Box(Plane.WorldXY, new Interval(0, 1), new Interval(0, 1), new Interval(0, 1));

    List<Transform> scale_T = new List<Transform>();
    List<Transform> rotate_T = new List<Transform>();
    List<Transform> move_T = new List<Transform>();


    //Creating Planes
    var origin = Point3d.Origin;


    //0 - Top
    scale_T.Add((Transform.Scale(Plane.WorldXY, L, D, board_thickness)));
    rotate_T.Add(Transform.Rotation(0, Point3d.Origin));
    move_T.Add((Transform.Translation(0, 0, H - board_thickness)));


    if(leg_type == 0)
    {

      //1 - Bottom
      scale_T.Add((Transform.Scale(Plane.WorldXY, L - (2 * board_thickness), skirting_height, board_thickness)));
      rotate_T.Add(Transform.Rotation(Math.PI / 2, Vector3d.XAxis, Point3d.Origin));
      move_T.Add((Transform.Translation(board_thickness, 2 * board_thickness, 0)));

      //2 - Front
      scale_T.Add((Transform.Scale(Plane.WorldXY, L - (2 * board_thickness), skirting_height, board_thickness)));
      rotate_T.Add(Transform.Rotation(Math.PI / 2, Vector3d.XAxis, Point3d.Origin));
      move_T.Add((Transform.Translation(board_thickness, 2 * board_thickness, 0)));

      //3 - Back
      scale_T.Add((Transform.Scale(Plane.WorldXY, 0, 0, 0)));
      rotate_T.Add(Transform.Rotation(0, Vector3d.YAxis, Point3d.Origin));
      move_T.Add((Transform.Translation(0, 0, 0)));


      //4 - SideLeft
      scale_T.Add((Transform.Scale(Plane.WorldXY, H - board_thickness, D - board_thickness, board_thickness)));
      rotate_T.Add(Transform.Rotation(3 * Math.PI / 2, Vector3d.YAxis, Point3d.Origin));
      move_T.Add((Transform.Translation(board_thickness, board_thickness, 0)));

      //5 - SideRight
      scale_T.Add((Transform.Scale(Plane.WorldXY, -(H - board_thickness), D - board_thickness, board_thickness)));
      rotate_T.Add(Transform.Rotation(Math.PI / 2, Vector3d.YAxis, Point3d.Origin));
      move_T.Add((Transform.Translation(L - board_thickness, board_thickness, 0)));


    }

    if(leg_type == 1)
    {

      //1 - Bottom
      scale_T.Add((Transform.Scale(Plane.WorldXY, L - 2 * board_thickness, D - board_thickness, -board_thickness)));
      rotate_T.Add(Transform.Rotation(0, Point3d.Origin));
      move_T.Add((Transform.Translation(board_thickness, board_thickness, skirting_height)));


      //2 - Front //null
      scale_T.Add((Transform.Scale(Plane.WorldXY, 0, 0, 0)));
      rotate_T.Add(Transform.Rotation(0, Vector3d.YAxis, Point3d.Origin));
      move_T.Add((Transform.Translation(0, 0, 0)));


      //3 - Back //null
      scale_T.Add((Transform.Scale(Plane.WorldXY, 0, 0, 0)));
      rotate_T.Add(Transform.Rotation(0, Vector3d.YAxis, Point3d.Origin));
      move_T.Add((Transform.Translation(0, 0, 0)));

      //4 - SideLeft
      scale_T.Add((Transform.Scale(Plane.WorldXY, H - skirting_height, D - board_thickness, board_thickness)));
      rotate_T.Add(Transform.Rotation(3 * Math.PI / 2, Vector3d.YAxis, Point3d.Origin));
      move_T.Add((Transform.Translation(board_thickness, board_thickness, skirting_height - board_thickness)));

      //5 - SideRight
      scale_T.Add((Transform.Scale(Plane.WorldXY, -(H - skirting_height), D - board_thickness, board_thickness)));
      rotate_T.Add(Transform.Rotation(Math.PI / 2, Vector3d.YAxis, Point3d.Origin));
      move_T.Add((Transform.Translation(L - board_thickness, board_thickness, skirting_height - board_thickness)));

    }




    if(leg_type == 2)
    {

      //1 - Bottom
      scale_T.Add((Transform.Scale(Plane.WorldXY, L - 2 * board_thickness, D - board_thickness, -board_thickness)));
      rotate_T.Add(Transform.Rotation(0, Point3d.Origin));
      move_T.Add((Transform.Translation(board_thickness, board_thickness, skirting_height)));

      //2 - Front
      scale_T.Add((Transform.Scale(Plane.WorldXY, L - (2 * board_thickness), skirting_height, board_thickness)));
      rotate_T.Add(Transform.Rotation(Math.PI / 2, Vector3d.XAxis, Point3d.Origin));
      move_T.Add((Transform.Translation(board_thickness, 2 * board_thickness, 0)));

      //3 - Back //null
      scale_T.Add((Transform.Scale(Plane.WorldXY, 0, 0, 0)));
      rotate_T.Add(Transform.Rotation(0, Vector3d.YAxis, Point3d.Origin));
      move_T.Add((Transform.Translation(0, 0, 0)));

      //4 - SideLeft
      scale_T.Add((Transform.Scale(Plane.WorldXY, H - board_thickness, D - board_thickness, board_thickness)));
      rotate_T.Add(Transform.Rotation(3 * Math.PI / 2, Vector3d.YAxis, Point3d.Origin));
      move_T.Add((Transform.Translation(board_thickness, board_thickness, 0)));

      //5 - SideRight
      scale_T.Add((Transform.Scale(Plane.WorldXY, -(H - board_thickness), D - board_thickness, board_thickness)));
      rotate_T.Add(Transform.Rotation(Math.PI / 2, Vector3d.YAxis, Point3d.Origin));
      move_T.Add((Transform.Translation(L - board_thickness, board_thickness, 0)));

    }


    for (int i = 0; i < scale_T.Count; i++)
    {
      BoundingBox d = base_box;
      // d.Transform(scale_T[i]);
      // d.Transform(rotate_T[i]);
      // d.Transform(move_T[i]);
      Transform t = move_T[i] * rotate_T[i] * scale_T[i];
      d.Transform(t);
      b.Add(d);
      //*scale_T[0]);
    }

    return b;
  }
# ---------- end carcass_outer ----------
carcass_column = CSharpScript(
    reset=bool_4,
    L=carcass_length_4,
    D=carcass_depth_4,
    H=carcass_height_4,
    board_thickness=board_thickness_4,
    skirting_height=skirting_height_4,
    base_placement=shelves_placement_2,
    leg_type=num_6)  # -> out, column_support, front_board; inputs reset: Boolean, L: Double, D: Double, H: Double, board_thickness: Double, skirting_height: Double, base_placement: tree of Point3d, leg_type: Int32
# ---------- carcass_column: C# ----------
    // Component written by Pallavi Ray
    // POST 105
    // August, 2023
    // V0.1
    Component.NickName = "Carcass_Column";
    Component.Description = "Creates an columns for straight unit";
    //Considering that the center boards columns are 2*board_thickness

    if(init || reset)
    {
      init = false;
      column_DT.Clear();
      column_DT.AddRange(update(L, D, H, board_thickness, skirting_height, base_placement, leg_type), path);

    }

    column_support = column_DT;
# ---------- carcass_column: C# additional code ----------
  public bool init = true;
  public DataTree<BoundingBox> column_DT = new DataTree<BoundingBox>();
  public GH_Path path = new GH_Path(0, 1);//update later to include the path of the unit type

  public List<BoundingBox> update(double L, double D, double H, double board_thickness, double skirting_height, DataTree<Point3d> base_placement, int leg_type)
  {

    BoundingBox base_box = new BoundingBox(new Point3d(0, 0, 0), new Point3d(1, 1, 1));
    //Box base_box = new Box(Plane.WorldXY, new Interval(0, 1), new Interval(0, 1), new Interval(0, 1));


    ///////////////////////////////COLUMN SUPPORT///////////////////////////////
    //Set up tree Column Support Transform
    List<Transform> column_list = new List<Transform>();

    for(int i = 0; i < base_placement.BranchCount;i++)
    {
      if(leg_type == 0)
      {
        Transform move = Transform.Translation(base_placement.Branch(i)[0].X, board_thickness, 0);
        column_list.Add(move);
      }
      else
      {
        Transform move = Transform.Translation(base_placement.Branch(i)[0].X, board_thickness, skirting_height);
        column_list.Add(move);
      }

    }


    //Create the column
    //Create the scale transform for one column

    Transform scale_col = new Transform();
    if(leg_type == 0)
    {
      scale_col = Transform.Scale(Plane.WorldXY, H - board_thickness, D - board_thickness, 2 * board_thickness);
    }
    else
    {
      scale_col = Transform.Scale(Plane.WorldXY, H - skirting_height - board_thickness, D - board_thickness, 2 * board_thickness);
    }


    //Create the rotate transform for one column
    Transform rotate_col = Transform.Rotation(3 * Math.PI / 2, Vector3d.YAxis, Point3d.Origin);

    //Generate the data tree for the support column
    List<BoundingBox> columns = new List<BoundingBox>();

    //starting from 1 as the first board wont be present
    for(int i = 1; i < base_placement.BranchCount;i++)
    {
      var b = base_box;
      Transform t = column_list[i] * rotate_col * scale_col;
      b.Transform(t);
      columns.Add(b);

    }


    return columns;
  }
# ---------- end carcass_column ----------
carcass_shelves = CSharpScript(
    reset=bool_5,
    L=carcass_length_5,
    D=carcass_depth_5,
    H=carcass_height_5,
    board_thickness=board_thickness_5,
    skirting_height=skirting_height_5,
    base_placement=shelves_placement_3,
    leg_type=num_7)  # -> out, base_board; inputs reset: Boolean, L: Double, D: Double, H: Double, board_thickness: Double, skirting_height: Double, base_placement: tree of Point3d, leg_type: Int32
# ---------- carcass_shelves: C# ----------
    // Component written by Pallavi Ray
    // POST 105
    // August, 2023
    // V0.1
    Component.NickName = "Carcass_Shelves";
    Component.Description = "Creates an inner carcass for straight unit";
    //Considering that the center boards columns are 2*board_thickness


    if(init || reset)
    {
init=false;
      shelves_ = update(L, D, H, board_thickness, skirting_height, base_placement, leg_type);

    }

    base_board = shelves_;
# ---------- carcass_shelves: C# additional code ----------
  public bool init = true;
  public DataTree<BoundingBox> shelves_ = new DataTree<BoundingBox>();

  public DataTree<BoundingBox> update(double L, double D, double H, double board_thickness, double skirting_height, DataTree<Point3d> base_placement, int leg_type)
  {

    BoundingBox base_box = new BoundingBox(new Point3d(0, 0, 0), new Point3d(1, 1, 1));
    //Box base_box = new Box(Plane.WorldXY, new Interval(0, 1), new Interval(0, 1), new Interval(0, 1));


    ///////////////////////////////SHELVES///////////////////////////////
    //Set up tree Base Shelves Transform
    DataTree<Transform> shelves_T = new DataTree<Transform>();

    for(int i = 0; i < base_placement.BranchCount;i++)
    {
      GH_Path pth = new GH_Path(i);

      for (int j = 0; j < base_placement.Branch(i).Count;j++)
      {

        Transform move = new Transform(0);

        if(leg_type == 1 && j == 0)
        {}else
        {
          move = Transform.Translation(base_placement.Branch(i)[j].X,
            base_placement.Branch(i)[j].Y + board_thickness,
            base_placement.Branch(i)[j].Z);

        }
        shelves_T.Add(move, pth);
      }
    }


    //Create the shelves
    //Create the scale transform for one shelf
    double num_col = base_placement.BranchCount;

    Transform scale = Transform.Scale(Plane.WorldXY,
      (L - (2 * num_col * board_thickness)) / num_col,
      D - board_thickness,
      -board_thickness);


    DataTree<BoundingBox> shelves = new DataTree<BoundingBox>();

    for(int i = 0; i < base_placement.BranchCount;i++)
    {
      GH_Path pth = new GH_Path(0,0, i);
      for (int j = 0; j < base_placement.Branch(i).Count;j++)

      {
        BoundingBox b = new BoundingBox(new Point3d(0, 0, 0), new Point3d(0, 0, 0));

        if(leg_type != 0 && j == 0)
        {}else
        {
          //BoundingBox rc;

          b = base_box;
          Transform t = shelves_T.Branch(i)[j] * scale;
          b.Transform(t);

        }
        shelves.Add(b, pth);
      }
    }


    return shelves;
  }
# ---------- end carcass_shelves ----------
column_support = Brep(carcass_column.column_support)

outercarcass_geo = Data(carcass_outer.outerCarcass)
base_board = Geometry(carcass_shelves.base_board)
list_item_2 = ListItem(List=reverse(base_board), Index=0, Wrap=True)
item = ListItem(List=outercarcass_geo, Index=4, Wrap=True)
item_2 = ListItem(List=outercarcass_geo, Index=5, Wrap=True)
item_3 = ListItem(List=outercarcass_geo, Index=1, Wrap=True)
item_4 = ListItem(List=outercarcass_geo, Index=0, Wrap=True)
panel_22 = Panel(column_support)
side0_geometry = Brep(item)
side1_geometry = Brep(item_2)
top_geometry = Brep(item_4)
base = Brep(item_3)
panel_23 = Panel(list_item_2)
column_support_2 = Brep(column_support)
side1_geometry_2 = Brep(side1_geometry)
base_2 = Brep(base)
geometry = Geometry(list_item_2)
top_geometry_2 = Brep(top_geometry)
side0_geometry_2 = Brep(side0_geometry)

# ----
# Leg
carcass_length_6 = Data(carcass_length)
carcass_depth_6 = Data(carcass_depth)
rectangle = Rectangle(Plane=PlaneXY(0, 0, 0), XSize=carcass_length_6, YSize=carcass_depth_6, Radius=0)  # -> Rectangle, Length
offset = OffsetCurve(Curve=rectangle.Rectangle, Distance="-100", Corners=1)
explode = Explode(Curve=offset, Recursive=True)  # -> Segments, Vertices
cullpt = CullDuplicates(Points=explode.Vertices, Tolerance=0.1, CullMode=3)  # -> Points, Indices, Valence
skirting_height_6 = Data(skirting_height)
board_thickness_6 = Data(board_thickness)

rounded_leg = Rounded_leg(T=cullpt.Points, A=skirting_height_6, B=board_thickness_6)

leg_2 = Data(rounded_leg)

leg_3 = Data(leg_2)
merge = Merge(
    Data1=flatten(top_geometry_2),
    Data2=flatten(side0_geometry_2),
    Data3=flatten(side1_geometry_2),
    Data4=flatten(base_2),
    Data5=flatten(column_support_2),
    Data6=flatten(leg_3),
    Data7=flatten(geometry))  # -> flatten(Result)
geo = Geometry(merge)
mesh = MeshBrep(
    Brep=graft(geo),
    Settings={GridMaxCount=0, GridMinCount=16, JaggedSeams=False, MaxEdgeLength=0, MinEdgeLength=0.0001, MinTolerance=0, Refine=True, RefineAngle=0, RelativeTolerance=0.65, SimplePlanes=True, Tolerance=0})
mjoin = MeshJoin(Meshes=mesh)

# ---- group: RH_OUT:mesh
mesh_2 = Mesh(mjoin)

# ==== cluster Rounded_leg
A = ClusterInput()
B = ClusterInput()
subtraction = Subtraction(A=A, B=B)
cir = Circle(Plane=PlaneXY(0, 0, 0), Radius="10")
Z = UnitZ(Factor=subtraction)
extr = Extrude(Base=cir, Direction=Z)
vec = VectorXYZ(XComponent=0, YComponent=0, ZComponent=0)  # -> Vector, Length
T = ClusterInput()
cap = CapHoles(Brep=extr)
move = Move(Geometry=cap, Motion=T)  # -> Geometry, Transform
G = ClusterOutput(move.Geometry)
